# Grasshopper definition Spraying Code Geodesic.gh (Grasshopper 1.0.7)
# plug-ins: HAL for Grasshopper

# Scanned surface
sessionsettings = SessionSettings()

# ---- group: Trim processed surface
panel = Panel("""2179.7
-1320.0
164.5""")
panel_2 = Panel("""2505.4
-380.2
161.3""")
panel_3 = Panel("""1235.3
-984.3
161.3""")
srf = Surface(<surface referenced from the Rhino model>)
# NOTE: Table reference is the
# robot world.
brep = Brep(<brep referenced from the Rhino model>)
pt = Point(Point(0, 0, 41.8434187))
pt_2 = Point(Point(1028.5, 0, 33.00394248))
pt_3 = Point(Point(1028.5, 1008.5, 0))
pl_3pt = Plane3Pt(PointA=pt, PointB=pt_2, PointC=pt_3)
bbx = BrepBrep(BrepA=brep, BrepB=srf)  # -> Curves, Points
num2pt = NumbersToPoints(Numbers=panel, Mask=4)
num2pt_2 = NumbersToPoints(Numbers=panel_2, Mask=4)
num2pt_3 = NumbersToPoints(Numbers=panel_3, Mask=4)
srfsplit = SurfaceSplit(Surface=srf, Curves=bbx.Curves)
item = ListItem(List=srfsplit, Index=0, Wrap=True)  # -> Item, Item1
pl_3pt_2 = Plane3Pt(PointA=num2pt_3, PointB=num2pt, PointC=num2pt_2)
c_script = CSharpScript(G=item.Item1, P1=pl_3pt_2, P2=pl_3pt)  # -> out, A; inputs G: Brep, P1: Plane, P2: Plane
# ---------- c_script: C# ----------
    A = G;
    ((Brep)A).Transform(Transform.ChangeBasis(P1, P2));
# ---------- end c_script ----------
srf_2 = Surface(c_script.A)

# ---- group: Test sphere
avr = Average(Input=[num2pt_3, num2pt, num2pt_2])
Z = UnitZ(Factor="1500")
move = Move(Geometry=avr, Motion=Z)  # -> Geometry, Transform
planesrf = PlaneSurface(Plane=avr, XSize="-500 to 500", YSize="-500 to 500")
extr = Extrude(Base=planesrf, Direction=Z)
qsph = QuadSphere(Base=move.Geometry, Radius="1500")
split = SplitBrep(Brep=qsph, Cutter=extr)
item_2 = ListItem(List=split, Index=0, Wrap=True)  # -> Item, Item1

# ----
table_reference_point = Panel("""0
0
0""")
num2pt_4 = NumbersToPoints(Numbers=table_reference_point, Mask=4)

# ----
# Plane angle to start geodesic curves.
plane_angle = Slider(45, range=0..45)

# ----
# Waste basket in the table's reference space.
waste_basket_location_to_table_reference = Panel("""3200
-600
100""")
num2pt_5 = NumbersToPoints(Numbers=waste_basket_location_to_table_reference, Mask=4)
tag = TextTag(Location=num2pt_5, Text="Waste basket")

# ----
# Point location of the table's reference in world space.
table_reference_point_2 = Point(num2pt_4)

# ----
# Settings
# Surface in the table's reference space.
surface = Surface(item_2.Item1)

# ---- group: Robot settings
spray_blend_angle = Slider(5, range=0..30)
spray_speed_on_surface = Slider(200, range=0..500)
spray_speed_off_surface = Slider(500, range=0..500)
wait_time = Slider(3, range=0..60)
export_directory = Panel("\\Mac\Home\OneDrive - University of Cambridge\PhD Work\20201130 - Spraying HAL Code\20201215 - 3D Formwork Scan\20210104")
target_distance_filter = Slider(10, range=0..100)
blend_distance = Slider(10, range=0..100)

# ---- group: Spray geometry settings
# Overspray should be greater than half of spray distance.
# Set as same seems to be safe.
spray_diameter = Slider(200, range=0..300)
overspray_distance = Slider(100, range=0..300)

# ----
overlap_ratio = Slider(0, range=0..100)
expression = Expression(d=spray_diameter, o=overlap_ratio, Expression="d*(1-o/100)")
plane_angle_2 = Number(plane_angle)

# ---- group: Inputs
# Generate spraying path from surface
surf = Surface(surface)
overspray_distance_2 = Number(overspray_distance)
separation_dist = Number(expression)
addition = Addition(A=plane_angle_2, B=Slider(90, range=0..100))
merge = Merge(Data1=plane_angle_2, Data2=addition)
rad = Radians(Degrees=merge)
spray_paths = GhPythonScript(surf=surf, angle=rad, dist=separation_dist, overspray_dist=overspray_distance_2)  # -> path; inputs surf: Brep
# ---------- spray_paths: Python ----------
import os
import sys

dir = os.path.dirname(ghdoc.Path)
dir = os.path.join(dir, 'src')
sys.path.insert(1, dir)

import spray_path
spray_path = reload(spray_path)

path = spray_path.spray_path(surf, angle, dist, overspray_dist)
# ---------- end spray_paths ----------

# ----
item_3 = ListItem(List=spray_paths, Index=0, Wrap=True)  # -> Item, Item1

# ---- group: Outputs
patch_surface = Surface()
path_1 = Curve(item_3.Item)
path_2 = Curve(item_3.Item1)

# ---- group: Find overspray boundary
overspray_distance_3 = Number(overspray_distance)
segment_surface = Surface(surface)
patch_surface_2 = Surface(patch_surface)
offset_surf_bounds = GhPythonScript(surf=segment_surface, extended_surf=patch_surface_2, dist=overspray_distance_3)  # -> out, bounds; inputs surf: Brep, extended_surf: Surface
# ---------- offset_surf_bounds: Python ----------
import os
import sys

dir = os.path.dirname(ghdoc.Path)
dir = os.path.join(dir, 'src')
sys.path.insert(1, dir)

import offset_surf_bounds as osb
osb = reload(osb)

bounds = osb.offset_surf_bounds(surf, extended_surf, dist)
# ---------- end offset_surf_bounds ----------
overspray_boundary = Curve(offset_surf_bounds.bounds)

# ---- group: Rationalise path from start to finish
overspray_boundary_2 = Curve(overspray_boundary)
waste_basket_point = Point(num2pt_5)
path1 = Curve(path_1)
path2 = Curve(path_2)
crv_cp = CurveClosestPoint(Point=waste_basket_point, Curve=overspray_boundary_2)  # -> Point, Parameter, Distance
find_complete_path = CSharpScript(hullCurve=overspray_boundary_2, path1=path1, path2=path2, startingParam=crv_cp.Parameter)  # -> out, connectedPaths; inputs hullCurve: Curve, path1: Curve, path2: Curve, startingParam: Double
# ---------- find_complete_path: C# usings ----------
using System.Linq;
# ---------- find_complete_path: C# ----------
    List<Curve> paths = new List<Curve>();

    // Find params on hull of paths
    double t1s, t1e, t2s, t2e;
    hullCurve.ClosestPoint(path1.PointAtStart, out t1s);
    hullCurve.ClosestPoint(path1.PointAtEnd, out t1e);
    hullCurve.ClosestPoint(path2.PointAtStart, out t2s);
    hullCurve.ClosestPoint(path2.PointAtEnd, out t2e);
    double[] ts = new double[] {t1s, t1e, t2s, t2e};

    // Find the shortest path from starting to any path ends
    var startCurve = FindMinCurve(hullCurve, startingParam, ts);
    if (startCurve.Item2 != null)
      paths.Add(startCurve.Item2);

    // Add the first path
    double nextStartParam = 0;
    var nextPossibleParams = new double[0];
    Curve nextPath = path1;

    if (startCurve.Item1 <= 1)
    {
      // Path 1 first
      nextPossibleParams = new double[] {ts[2], ts[3]};
      nextPath = path2;

      nextStartParam = startCurve.Item1 == 0 ? ts[1] : ts[0];

      if (startCurve.Item1 == 1)
        path1.Reverse();

      paths.Add(path1);
    }
    else
    {
      // Path 2 first
      nextPossibleParams = new double[] {ts[0], ts[1]};
      nextPath = path1;

      nextStartParam = startCurve.Item1 == 2 ? ts[3] : ts[2];

      if (startCurve.Item1 == 3)
        path2.Reverse();

      paths.Add(path2);
    }

    // Add connector between the two
    var connectorCurve = FindMinCurve(hullCurve, nextStartParam, nextPossibleParams);
    if (connectorCurve.Item2 != null)
      paths.Add(connectorCurve.Item2);

    // Add the second path
    if (connectorCurve.Item1 == 0)
      nextStartParam = nextPossibleParams[1];
    else
    {
      nextStartParam = nextPossibleParams[0];
      nextPath.Reverse();
    }

    paths.Add(nextPath);

    // Return to starting param
    var endCurve = MinSubCurve(hullCurve, nextStartParam, startingParam);
    if (endCurve != null)
      paths.Add(endCurve);

    connectedPaths = paths.ToArray();
# ---------- find_complete_path: C# additional code ----------
  private Tuple<int, Curve> FindMinCurve(Curve curve, double start, double[] targets)
  {
    // Find the minimum distance curve between the start and target parameters
    // Returns the index of the minimum target
    List<Curve> curves = new List<Curve>();
    List<double> curveLengths = new List<double>();
    foreach(double target in targets)
    {
      if (RhinoMath.EpsilonEquals(target, start, RhinoDocument.ModelAbsoluteTolerance))
        return Tuple.Create(Array.IndexOf(targets, target), (Curve) null);
      curves.Add(MinSubCurve(curve, start, target));
      curveLengths.Add(curves.Last().GetLength());
    }

    int index = curveLengths.IndexOf(curveLengths.Min());

    return Tuple.Create(index, curves[index]);
  }

  private Curve GetSubCurve(Curve curve, double t1, double t2)
  {
    // Find the curve between two parameters
    if (RhinoMath.EpsilonEquals(t1, t2, RhinoDocument.ModelAbsoluteTolerance))
      return null;

    if (t1 < t2)
      return curve.Trim(t1, t2);
    else
    {
      var domain = curve.Domain;
      var c0 = curve.Trim(t1, domain.T1);
      var c1 = curve.Trim(domain.T0, t2);
      var joinedCurve = Curve.JoinCurves(new List<Curve>() {c0, c1}).FirstOrDefault();
      return joinedCurve;
    }
  }

  private Curve MinSubCurve(Curve curve, double t1, double t2)
  {
    var c0 = GetSubCurve(curve, t1, t2);
    var c1 = GetSubCurve(curve, t2, t1);
    c1.Reverse();

    if (c0.GetLength() < c1.GetLength())
      return c0;
    else
      return c1;
  }
# ---------- end find_complete_path ----------
paths = Geometry(find_complete_path.connectedPaths)

# ---- group: Visualise circles
spray_diameter_2 = Number(spray_diameter)
# Visualise spraying
patch_surface_3 = Surface(patch_surface)
path1_2 = Curve()
path2_2 = Curve()
entwine = Entwine(Branch00=path1_2, Branch01=path2_2, FlattenInputs=True)  # -> simplify(Result)
multiplication = Multiplication(A=spray_diameter_2, B="0.1")
divlength = DivideLength(Curve=entwine, Length=multiplication)  # -> Points, Tangents, Parameters
srf_cp = SurfaceClosestPoint(Point=divlength.Points, Surface=patch_surface_3)  # -> Point, UVPoint, Distance
evalsrf = EvaluateSurface(Surface=patch_surface_3, Point=srf_cp.UVPoint)  # -> Point, Normal, UDirection, VDirection, Frame
pl = PlaneNormal(Origin=divlength.Points, ZAxis=evalsrf.Normal)
division = Division(A=spray_diameter_2, B=2)
cir = Circle(Plane=pl, Radius=division)
spray_circles = Geometry(cir)
lng = ListLength(List=spray_circles)  # -> flatten(Length)
series = Series(Start=0, Step=1, Count=lng)
gradient = Gradient(
    LowerLimit=0,
    UpperLimit=lng,
    Parameter=series,
    stops=[0: RGB(234, 38, 0), 0.25: RGB(234, 126, 0), 0.5: RGB(254, 244, 84), 1: RGB(75, 107, 169)])
bang = ExplodeTree(Data=simplify(spray_circles))  # -> Branch0, Branch1
bang_2 = ExplodeTree(Data=simplify(gradient))  # -> Branch0, Branch1
spray_circles_2 = Geometry(spray_circles)
preview = CustomPreview(Geometry=bang.Branch0, Material=bang_2.Branch0)
preview_2 = CustomPreview(Geometry=bang.Branch1, Material=bang_2.Branch1)

# ---- group: Find spray boundary
spray_diameter_3 = Number(spray_diameter)
segment_surface_2 = Surface(surface)
patch_surface_4 = Surface(patch_surface)
division_2 = Division(A=spray_diameter_3, B=2)
offset_surf_bounds_2 = GhPythonScript(surf=segment_surface_2, extended_surf=patch_surface_4, dist=division_2)  # -> out, bounds; inputs surf: Brep, extended_surf: Surface; same code as offset_surf_bounds
spray_boundary = Curve(offset_surf_bounds_2.bounds)

# ---- group: Split paths to be on and off surface
paths_2 = Geometry(paths)
spray_boundary_2 = Curve(spray_boundary)
project = Project(Geometry=spray_boundary_2, Plane=PlaneXY(0, 0, 0))  # -> Geometry, Transform
area = Area(Geometry=project.Geometry)  # -> Area, Centroid
scale_nu = ScaleNU(Geometry=project.Geometry, Plane=area.Centroid, ScaleX="0.999", ScaleY="0.999", ScaleZ=1)  # -> Geometry, Transform
trim_curve_boundary = GhPythonScript(curve=paths_2, cutter=scale_nu.Geometry)  # -> simplify(inside_curves), simplify(outside_curves); inputs curve: Curve, cutter: Curve
# ---------- trim_curve_boundary: Python ----------
import os
import sys

dir = os.path.dirname(ghdoc.Path)
dir = os.path.join(dir, 'src')
sys.path.insert(1, dir)

import trim_curve_boundary as tcb
tcb = reload(tcb)

[inside_curves, outside_curves] = tcb.trim_curve_boundary(curve, cutter)
# ---------- end trim_curve_boundary ----------
python = GhPythonScript(curve=paths_2, cutter=scale_nu.Geometry)  # -> out, simplify(insideCurves), simplify(outsideCurves); inputs curve: Curve, cutter: Curve
# ---------- python: Python ----------
__author__ = "Mishael Nuh"
__version__ = "2021.01.06"

import Rhino.Geometry as rg
import Rhino.RhinoDoc as rd

tol = rd.ActiveDoc.ModelAbsoluteTolerance
aTol = rd.ActiveDoc.ModelAngleToleranceRadians
tolZ = rg.Vector3d(0, 0, tol)

bBox = curve.GetBoundingBox(False)
basePlane = rg.Plane(bBox.Min - 2 * tolZ, rg.Vector3d.ZAxis)
projectedCutter = rg.Curve.ProjectToPlane(cutter, basePlane)
extrudeDir = rg.Vector3d(0, 0, bBox.Max.Z - bBox.Min.Z + 4 * tol)
extrusion = rg.Surface.CreateExtrusion(projectedCutter, extrudeDir)
extrusion = extrusion.ToBrep().CapPlanarHoles(tol)

intersections = [curve.Domain.Min]
intersections.extend(rg.Intersect.Intersection.CurveBrep(
    curve, extrusion, tol, aTol)[1])
intersections.append(curve.Domain.Max)

insideCurves = []
outsideCurves = []
for i in range(len(intersections) - 1):
    c = curve.Trim(intersections[i], intersections[i + 1])
    mid = (intersections[i] + intersections[i + 1]) / 2
    if (extrusion.IsPointInside(c.PointAtNormalizedLength(0.5), tol, False)):
        insideCurves.append(c)
    else:
        outsideCurves.append(c)
        
# Do check with random point and flip inside and outside depending on result
checkP = rg.Point3d(bBox.Min.X - 100, bBox.Min.Y - 100, bBox.Min.Z - 100)
if (extrusion.IsPointInside(checkP, tol, False)):
    tmp = outsideCurves
    outsideCurves = insideCurves
    insideCurves = tmp
# ---------- end python ----------
end = EndPoints(Curve=paths_2)  # -> Start, End
end_2 = EndPoints(Curve=trim_curve_boundary.outside_curves)  # -> Start, End
end_3 = EndPoints(Curve=trim_curve_boundary.inside_curves)  # -> Start, End
dist = Distance(PointA=graft(end.Start), PointB=end_2.Start)
dist_2 = Distance(PointA=graft(end.Start), PointB=end_3.Start)
sort = SortList(Keys=dist_2)  # -> Keys, ValuesA
sort_2 = SortList(Keys=dist)  # -> Keys, ValuesA
item_4 = ListItem(List=sort_2.Keys, Index=0, Wrap=True)
item_5 = ListItem(List=sort.Keys, Index=0, Wrap=True)
smaller = SmallerThan(FirstNumber=item_5, SecondNumber=item_4)  # -> simplify(SmallerThan), OrEqualTo
c_script_2 = CSharpScript(filter=smaller.SmallerThan, L1=python.insideCurves, L2=python.outsideCurves)  # -> out, merged, mask; inputs L1: list, L2: list
# ---------- c_script_2: C# ----------
    List<object> ret = new List<object>();
    List<bool> listMask = new List<bool>();

    if (filter == null)
    {
      merged = L1.Concat(L2);
      listMask = Enumerable.Repeat(true, L1.Count).ToList();
      listMask = listMask.Concat(Enumerable.Repeat(false, L2.Count).ToList()).ToList();
      mask = listMask;
      return;
    }
    if ((bool)filter)
    {
      for (int i = 0; i < L1.Count || i < L2.Count; i++)
      {
        if (L1.Count - 1 >= i)
        {
          ret.Add(L1[i]);
          listMask.Add(true);
        }
        if (L2.Count - 1 >= i)
        {
          ret.Add(L2[i]);
          listMask.Add(false);
        }
      }

    }
    else
    {
      for (int i = 0; i < L1.Count || i < L2.Count; i++)
      {
        if (L2.Count - 1 >= i)
        {
          ret.Add(L2[i]);
          listMask.Add(false);
        }
        if (L1.Count - 1 >= i)
        {
          ret.Add(L1[i]);
          listMask.Add(true);
        }
      }
    }
    merged = ret;
    mask = listMask;
# ---------- end c_script_2 ----------
is_path_on_surface = Boolean(c_script_2.mask)
paths_3 = Geometry(c_script_2.merged)

# ----
preview_3 = CustomPreview(Geometry=paths_3, Material=ColourSwatch(SwatchColor=RGB(0, 0, 0)))

# ---- group: Sprayer tool
pt_4 = Point(<point referenced from the Rhino model>)
swatch = ColourSwatch(SwatchColor=RGBA(189, 189, 189, 100))
# Define robot
xy = XYPlane(Origin=Point(0, 0, 0))
yz = YZPlane(Origin=pt_4)
geo = Geometry([<brep referenced from the Rhino model> x2])
panel_4 = Panel("flashlight")
tool = Tool(
    Alias=panel_4,
    Frame=xy,
    Object_Body=geo,
    Object_Color=swatch,
    ToolFrame=yz,
    _0_0=panel_4,
    _1_0=xy,
    _2_0=geo,
    _3_0=swatch,
    _6_0=yz,
    Mode=0,
    RunInBackground=False,
    nickName="Tool")

# ---- group: Table reference point
table_reference_point_3 = Point(table_reference_point_2)
# Settings and reference
panel_5 = Panel("tableRef")
reference = CreateReference(
    Alias=panel_5,
    Frame=table_reference_point_3,
    _0_0=panel_5,
    _1_0=table_reference_point_3,
    Mode=0,
    RunInBackground=False,
    nickName="Reference")
tableref = TableRef(reference, isNickNameImplied=True)

# ---- group: Robot
xy_2 = XYPlane(Origin=Point(0, 0, 0))
panel_6 = Panel("baseRobot")
robot = Robot(
    Alias=panel_6,
    Location=xy_2,
    _0_0=panel_6,
    _1_0=xy_2,
    Mode=0,
    RunInBackground=False,
    catalogItem="Mechanism,ce850552-3091-4db7-93ac-81867ea54116",
    nickName="⧉ Robot")
panel_7 = Panel("robot")
attach = Attach(
    Alias=panel_7,
    Parent=robot,
    Child=tool,
    IsEndEffector=True,
    InWorld=True,
    _0_0=panel_7,
    _1_0=robot,
    _2_0=tool,
    Mode=0,
    RunInBackground=False,
    nickName="Attach")
robot_2 = Robot(attach, isNickNameImplied=True)

# ---- group: Allow target rotation around Z axis
panel_8 = Panel("0")
panel_9 = Panel("2*Pi")
robot_3 = Robot(robot_2, isNickNameImplied=True)
constraints = TargetConstraints(
    RotationAxis={halEnum=2, halEnumType="HAL.Spatial.Axis"},
    MinRotationRad=panel_8,
    MaxRotationRad=panel_9,
    _2_0=panel_8,
    _3_0=panel_9,
    Mode=0,
    RunInBackground=False,
    nickName="Constraints")
kinematics = KinematicSettings(
    Mechanism=robot_3,
    TargetConstraints=constraints,
    _1_0=robot_3,
    _3_0=constraints,
    Mode=0,
    RunInBackground=False,
    nickName="Kinematics")

# ---- group: Spray settings
is_path_on_surface_2 = Boolean(is_path_on_surface)
spray_speed_off_surface_2 = Number(spray_speed_off_surface)
blend_distance_2 = Number(blend_distance)
spray_angle_tolerance = Number(spray_blend_angle)
spray_speed_on_surface_2 = Number(spray_speed_on_surface)
panel_10 = Panel("speedOnSurf")
panel_11 = Panel("speedOffSurf")
speed = SpeedSettings(
    Alias=panel_11,
    PositionMmS=spray_speed_off_surface_2,
    _0_0=panel_11,
    _1_0=spray_speed_off_surface_2,
    Mode=0,
    RunInBackground=False,
    nickName="Speed")
speed_2 = SpeedSettings(
    Alias=panel_10,
    PositionMmS=spray_speed_on_surface_2,
    _0_0=panel_10,
    _1_0=spray_speed_on_surface_2,
    Mode=0,
    RunInBackground=False,
    nickName="Speed")
p_n_c = PickNChoose(Pattern=graft(is_path_on_surface_2), Stream0="sprayOffSet", Stream1="sprayOnSet")
rad_2 = Radians(Degrees=spray_angle_tolerance)
panel_12 = Panel("sprayBlend")
blend = BlendSettings(
    Alias=panel_12,
    PositionMm=blend_distance_2,
    OrientationRad=rad_2,
    _0_0=panel_12,
    _1_0=blend_distance_2,
    _2_0=rad_2,
    Mode=0,
    RunInBackground=False,
    nickName="Blend")
p_n_c_2 = PickNChoose(Pattern=graft(is_path_on_surface_2), Stream0=speed, Stream1=speed_2)
path_mapper = PathMapper(p_n_c, source="{a;b}", target="{a}")
path_mapper_2 = PathMapper(p_n_c_2, source="{a;b}", target="{a}")
motionsettings = MotionSettings(
    Alias=path_mapper,
    Space={halEnum=0, halEnumType="HAL.Motion.Settings.MotionSpace"},
    Speed=path_mapper_2,
    Blend=blend,
    Kinematics=kinematics,
    _0_0=path_mapper,
    _2_0=path_mapper_2,
    _4_0=blend,
    _5_0=kinematics,
    Mode=0,
    RunInBackground=False,
    nickName="MotionSettings")

# ----
segment_surface_3 = Surface(surface)
# Visualise in robot world
table_reference_point_4 = Point(table_reference_point_2)
spray_circles_3 = Geometry(spray_circles_2)
vec2pt = Vector2Pt(PointA="{0,0,0}", PointB=table_reference_point_4, Unitize=False)  # -> Vector, Length
move_2 = Move(Geometry=spray_circles_3, Motion=vec2pt.Vector)  # -> Geometry, Transform
lng_2 = ListLength(List=move_2.Geometry)  # -> flatten(Length)
series_2 = Series(Start=0, Step=1, Count=lng_2)
move_3 = Move(Geometry=segment_surface_3, Motion=vec2pt.Vector)  # -> Geometry, Transform
gradient_2 = Gradient(
    LowerLimit=0,
    UpperLimit=lng_2,
    Parameter=series_2,
    stops=[0: RGB(234, 38, 0), 0.25: RGB(234, 126, 0), 0.5: RGB(254, 244, 84), 1: RGB(75, 107, 169)])
bang_3 = ExplodeTree(Data=simplify(move_2.Geometry))  # -> Branch0, Branch1
bang_4 = ExplodeTree(Data=simplify(gradient_2))  # -> Branch0, Branch1
preview_4 = CustomPreview(Geometry=move_3.Geometry, Material=ColourSwatch(SwatchColor=RGBA(145, 145, 145, 100)))
preview_5 = CustomPreview(Geometry=bang_3.Branch0, Material=bang_4.Branch0)
preview_6 = CustomPreview(Geometry=bang_3.Branch1, Material=bang_4.Branch1)

# ---- group: Move home
# Procedures
robot_4 = Robot(robot_2, isNickNameImplied=True)
j1 = Slider(0, range=-180..180)
j2 = Slider(0, range=-70..85)
j3 = Slider(0, range=-28..110)
j4 = Slider(0, range=-300..300)
j5 = Slider(30, range=-120..120)
j6 = Slider(0, range=-300..300)
angle = Angle(j1, isNickNameImplied=False, locked=False, unit="deg")
angle_2 = Angle(j2, isNickNameImplied=False, locked=False, unit="deg")
angle_3 = Angle(j3, isNickNameImplied=False, locked=False, unit="deg")
angle_4 = Angle(j4, isNickNameImplied=False, locked=False, unit="deg")
angle_5 = Angle(j5, isNickNameImplied=False, locked=False, unit="deg")
angle_6 = Angle(j6, isNickNameImplied=False, locked=False, unit="deg")
angle_rad = Angle(angle, isNickNameImplied=True, locked=True, unit="rad")
angle_rad_2 = Angle(angle_2, isNickNameImplied=True, locked=True, unit="rad")
angle_rad_3 = Angle(angle_3, isNickNameImplied=True, locked=True, unit="rad")
angle_rad_4 = Angle(angle_4, isNickNameImplied=True, locked=True, unit="rad")
angle_rad_5 = Angle(angle_5, isNickNameImplied=True, locked=True, unit="rad")
angle_rad_6 = Angle(angle_6, isNickNameImplied=True, locked=True, unit="rad")
position = Merge(
    Data1=flatten(angle_rad),
    Data2=flatten(angle_rad_2),
    Data3=flatten(angle_rad_3),
    Data4=flatten(angle_rad_4),
    Data5=flatten(angle_rad_5),
    Data6=flatten(angle_rad_6))
panel_13 = Panel("homeMoSet")
motionsettings_2 = MotionSettings(
    Alias=panel_13,
    Space={halEnum=1, halEnumType="HAL.Motion.Settings.MotionSpace"},
    _0_0=panel_13,
    Mode=0,
    RunInBackground=False,
    nickName="MotionSettings")
panel_14 = Panel("homeT")
target = Target(
    Alias=panel_14,
    Mechanism=robot_4,
    Object_Position=position,
    _0_0=panel_14,
    _1_0=robot_4,
    _2_0=position,
    Mode=0,
    RunInBackground=False,
    nickName="Target")
panel_15 = Panel("goHome")
move_4 = Move(
    Alias=panel_15,
    Object_Target=target,
    Object_MotionSettings=motionsettings_2,
    _0_0=panel_15,
    _1_0=target,
    _2_0=motionsettings_2,
    Mode=0,
    RunInBackground=False,
    nickName="Move")

# ---- group: Move to waste basket
waste_basket_position = Point(num2pt_5)
tableref_2 = TableRef(tableref, isNickNameImplied=True)
pflip = FlipPlane(Plane=waste_basket_position, ReverseX=False, ReverseY=False, SwapAxes=True)
panel_16 = Panel("wasteMoSet")
motionsettings_3 = MotionSettings(
    Alias=panel_16,
    Space={halEnum=1, halEnumType="HAL.Motion.Settings.MotionSpace"},
    Kinematics=kinematics,
    _0_0=panel_16,
    _5_0=kinematics,
    Mode=0,
    RunInBackground=False,
    nickName="MotionSettings")
panel_17 = Panel("wasteT")
target_2 = Target(
    Object_Alias=panel_17,
    Object_Frame=pflip,
    Reference=tableref_2,
    InWorld=False,
    _0_0=panel_17,
    _1_0=pflip,
    _2_0=tableref_2,
    Mode=0,
    RunInBackground=False,
    nickName="Target")
panel_18 = Panel("goWaste")
move_5 = Move(
    Alias=panel_18,
    Object_Target=target_2,
    Object_MotionSettings=motionsettings_3,
    _0_0=panel_18,
    _1_0=target_2,
    _2_0=motionsettings_3,
    Mode=0,
    RunInBackground=False,
    nickName="Move")

# ---- group: Wait
wait_time_2 = Number(wait_time)
panel_19 = Panel("wait")
waittime = WaitTime(
    Alias=panel_19,
    DurationS=wait_time_2,
    _0_0=panel_19,
    _1_0=wait_time_2,
    Mode=0,
    RunInBackground=False,
    nickName="WaitTime")

# ----
panel_20 = Panel("goSpray")

# ---- group: Spray
target_distance_filter_2 = Number(target_distance_filter)
patch_surface_5 = Geometry(patch_surface)
paths_4 = Curve(simplify(paths_3))
tableref_3 = TableRef(tableref, isNickNameImplied=True)
target_3 = Target(
    Alias="Curve",
    Curve=paths_4,
    Discretization={halEnum=1, halEnumType="HAL.McNeel.RhinoCommon5.Spatial.CurveDiscretization"},
    ToleranceMm=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,
    Reference=tableref_3,
    InWorld=False,
    _1_0=paths_4,
    _4_0=tableref_3,
    Mode=0,
    RunInBackground=False,
    nickName="Target")  # -> simplify(Object_Target), Trace
lng_3 = ListLength(List=target_3.Object_Target)
filter = TargetFilter(
    Object_Target=flatten(target_3.Object_Target),
    PositionMm=target_distance_filter_2,
    OrientationRad=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,
    _0_0=target_3,
    _1_0=target_distance_filter_2,
    Mode=0,
    RunInBackground=False,
    nickName="Filter")  # -> Object_Remaining, Object_Discarded, Object_Mask
path_mapper_3 = PathMapper(lng_3, source="{a;b}", target="{a}")
repeat = RepeatData(Data=graft(motionsettings), Length=graft(path_mapper_3))  # -> flatten(Data)
evalsrf_2 = EvaluateSurface(Surface=patch_surface_5, Point="{0.5, 0.5, 0}")  # -> Point, Normal, UDirection, VDirection, Frame
Z_2 = UnitZ(Factor=1)
cull = CullPattern(List=repeat, CullPattern=filter.Object_Mask)
dprod = DotProduct(VectorA=Z_2, VectorB=evalsrf_2.Normal, Unitize=False)
larger = LargerThan(FirstNumber=dprod, SecondNumber=0)  # -> LargerThan, OrEqualTo
normal = Normal(
    Target=flatten(filter.Object_Remaining),
    Guide=flatten(patch_surface_5),
    Axis={halEnum=2, halEnumType="HAL.Spatial.Axis"},
    Flip=larger.LargerThan,
    Project=False,
    _0_0=filter,
    _2_0=patch_surface_5,
    _4_0=larger,
    Mode=0,
    RunInBackground=False,
    nickName="Normal")  # -> simplify(Target), Object_OnGuide, Object_Normal
target_4 = TargetProperties(Target=normal.Target, _0_0=normal, Mode=0, RunInBackground=False, nickName="Target")  # -> Alias, Object_Joint, WayFrame, EndFrame, Reference, IsArc
vec2pt_2 = Vector2Pt(PointA="{0,0,0}", PointB=target_4.EndFrame, Unitize=True)  # -> Vector, Length
parallel = Parallel(
    Target=normal.Target,
    Direction=vec2pt_2.Vector,
    Axis={halEnum=1, halEnumType="HAL.Spatial.Axis"},
    Flip=False,
    Project=True,
    _0_0=normal,
    _2_0=vec2pt_2,
    Mode=0,
    RunInBackground=False,
    nickName="Parallel")  # -> flatten(Target)
move_6 = Move(
    Alias=panel_20,
    Object_Target=parallel,
    Object_MotionSettings=cull,
    _0_0=panel_20,
    _1_0=parallel,
    _2_0=cull,
    Mode=0,
    RunInBackground=False,
    nickName="Move")  # -> simplify(Action)

# ----
merge_2 = Merge(
    Data1=flatten(move_4),
    Data2=flatten(move_5),
    Data3=flatten(waittime),
    Data4=flatten(move_6),
    Data5=flatten(move_5),
    Data6=flatten(waittime),
    Data7=flatten(move_4))
panel_21 = Panel("SprayMod")
combine = CombineActions(
    Alias=panel_21,
    Object_Combined=merge_2,
    Compact=False,
    _0_0=panel_21,
    _1_0=merge_2,
    Mode=0,
    RunInBackground=False,
    nickName="Combine")

# ---- group: Solve robot
controller = ExecutionControl(Loop=False, TimeRatio=1)
solve = BooleanToggle(False)
export = BooleanToggle(False)
export_directory_2 = Text(export_directory)
# Solver
robot_5 = Robot(robot_2, isNickNameImplied=True)
panel_22 = Panel("controller")
controller_2 = Controller(
    Alias=panel_22,
    Object_Mechanism=robot_5,
    Object_Procedure=combine,
    _0_0=panel_22,
    _2_0=robot_5,
    _3_0=combine,
    Mode=0,
    RunInBackground=False,
    catalogItem="Controller,7ab5730a-2de3-481a-aaee-af392f24ce56",
    nickName="⧉ Controller")
solver = ProcedureSolver(Controller=controller_2, Solve=solve, Mode=0, RunInBackground=True)  # -> Solution, Object_Solved, Notification
execute = Execute(
    ExecutionControl=controller,
    Solution=solver.Solution,
    displayEnvironment=True,
    displayMechanisms=True,
    displayTrace=True)
export_2 = ExportProcedure(
    Controller=controller_2,
    Solution=solver.Solution,
    Destination=export_directory_2,
    Export=export,
    _0_0=controller_2,
    _1_0=solver,
    _2_0=export_directory_2,
    _3_0=export,
    Mode=0,
    RunInBackground=True,
    nickName="Export")

# ----
file = ReadFile(File=export_2, PerLineParse=True)
panel_23 = Panel(export_2)
panel_24 = Panel(file)

# ---- group: Visualise waste
# Visualise waste
waste_basket_point_2 = Point(num2pt_5)
is_path_on_surface_3 = Boolean(is_path_on_surface)
paths_5 = Curve(simplify(paths_3))
segment_surface_4 = Surface(surface)
not = GateNot(A=is_path_on_surface_3)
cull_2 = CullPattern(List=paths_5, CullPattern=not)
cull_3 = CullPattern(List=paths_5, CullPattern=is_path_on_surface_3)
bang_5 = ExplodeTree(Data=paths_5)  # -> Branch0, Branch1, Branch2, Branch3, Branch4
wires = BrepWireframe(Brep=segment_surface_4, Density=-1)
bang_6 = ExplodeTree(Data=cull_2)  # -> Branch0, Branch1, Branch2, Branch3, Branch4
end_4 = EndPoints(Curve=bang_5.Branch0)  # -> Start, End
end_5 = EndPoints(Curve=bang_5.Branch4)  # -> Start, End
join = JoinCurves(Curves=wires, Preserve=False)
bang_7 = ExplodeTree(Data=cull_3)  # -> Branch0, Branch1, Branch2, Branch3, Branch4
ln = Line(StartPoint=waste_basket_point_2, EndPoint=graft([end_4.Start, end_5.End]))  # -> flatten(Line)
python_2 = GhPythonScript(curve=[bang_7.Branch1, bang_7.Branch3], cutter=join)  # -> out, simplify(insideCurves), simplify(flatten(outsideCurves)); inputs curve: Curve, cutter: Curve
# ---------- python_2: Python ----------
__author__ = "Mishael Nuh"
__version__ = "2021.01.06"

import Rhino.Geometry as rg
import Rhino.RhinoDoc as rd

tol = rd.ActiveDoc.ModelAbsoluteTolerance
aTol = rd.ActiveDoc.ModelAngleToleranceRadians
tolZ = rg.Vector3d(0, 0, tol)

bBox = curve.GetBoundingBox(False)
basePlane = rg.Plane(bBox.Min - 2 * tolZ, rg.Vector3d.ZAxis)
projectedCutter = rg.Curve.ProjectToPlane(cutter, basePlane)
extrudeDir = rg.Vector3d(0, 0, bBox.Max.Z - bBox.Min.Z + 4 * tol)
extrusion = rg.Surface.CreateExtrusion(projectedCutter, extrudeDir)
extrusion = extrusion.ToBrep().CapPlanarHoles(tol)

intersections = [curve.Domain.Min]
intersections.extend(rg.Intersect.Intersection.CurveBrep(
    curve, extrusion, tol, aTol)[1])
intersections.append(curve.Domain.Max)

insideCurves = []
outsideCurves = []
for i in range(len(intersections) - 1):
    c = curve.Trim(intersections[i], intersections[i + 1])
    mid = (intersections[i] + intersections[i + 1]) / 2
    if (extrusion.IsPointInside(c.PointAtNormalizedLength(0.5), tol, True)):
        insideCurves.append(c)
    else:
        outsideCurves.append(c)
        
        
# Do check with random point and flip inside and outside depending on result
checkP = rg.Point3d(bBox.Min.X - 100, bBox.Min.Y - 100, bBox.Min.Z - 100)
if (extrusion.IsPointInside(checkP, tol, True)):
    tmp = outsideCurves
    outsideCurves = insideCurves
    insideCurves = tmp
# ---------- end python_2 ----------
crv = Curve(flatten([bang_5.Branch0, bang_5.Branch2, bang_5.Branch4, bang_6.Branch1, bang_6.Branch3]))
entwine_2 = Entwine(Branch00=crv, Branch01=python_2.outsideCurves, FlattenInputs=True)
len = Length(Curve=entwine_2)
ma = MassAddition(Input=len)  # -> flatten(Result), PartialResults
len_2 = Length(Curve=paths_5)  # -> flatten(Length)
ma_2 = MassAddition(Input=ma.Result)  # -> Result, PartialResults
ma_3 = MassAddition(Input=len_2)  # -> Result, PartialResults
round = Round(Number=ma.Result)  # -> Nearest, Floor, Ceiling
end_6 = EndPoints(Curve=entwine_2)  # -> Start, End
panel_25 = Panel("""Off surface length: 
On surface length: """)
division_3 = Division(A=ma_2.Result, B=ma_3.Result)
concat = Concatenate(FragmentA=panel_25, FragmentB=round.Nearest)  # -> graft(Result)
item_6 = ListItem(List=end_6.Start, Index=0, Wrap=True)
bang_8 = ExplodeTree(Data=item_6)  # -> Branch0, Branch1
bang_9 = ExplodeTree(Data=concat)  # -> Branch0, Branch1
area_2 = Area(Geometry=segment_surface_4)  # -> Area, Centroid
swatch_2 = ColourSwatch(SwatchColor=RGB(7, 94, 235))
swatch_3 = ColourSwatch(SwatchColor=RGB(235, 7, 7))
swatch_4 = ColourSwatch(SwatchColor=RGB(255, 255, 255))
preview_7 = CustomPreview(Geometry=crv, Material=swatch_3)
tag_2 = TextTag(Location=bang_8.Branch0, Text=bang_9.Branch0, Colour=swatch_3)
preview_8 = CustomPreview(Geometry=python_2.outsideCurves, Material=swatch_2)
tag_3 = TextTag(Location=bang_8.Branch1, Text=bang_9.Branch1, Colour=swatch_2)

# ----
multiplication_2 = Multiplication(A=division_3, B=100)
round_2 = Round(Number=multiplication_2)  # -> Nearest, Floor, Ceiling
concat_2 = Concatenate(FragmentA="Waste: ", FragmentB=round_2.Nearest, FragmentC="%")

# ---- group: Visualise waste (continued)
txt = Text(flatten([bang_9.Branch0, bang_9.Branch1, concat_2]))
panel_26 = Panel(txt)

# ----
tag_4 = TextTag(Location=area_2.Centroid, Text=concat_2, Colour=swatch_4)
